# Grasshopper definition WSBasicUnderstanding001.gh (Grasshopper 1.0.7)
# Copyright: Wickerson Studios
# plug-ins: Bifocals

# Wickerson Studio
# 
# created by: Michael Wickerson
# 
# Grasshopper for Rhino 3D Algorithmic Modeling
# 
# www.wickersonstudios.com
# www.michaelwickerson.com
# https://www.youtube.com/channel/UC7J48Ppcsa6oncp6d29R0xw
# https://github.com/mwickerson
# https://www.facebook.com/michael.wickerson
# https://www.linkedin.com/in/michael-wickerson-696a80156/
image_sampler = ImageSampler(
    FilePath="C:\Users\Sculpture\Documents\2020Grasshopper\ScreenShots2019\Screenshots2020\SurfaceEditAlgorithm.PNG",
    Filter="Value",
    Interpolate=False,
    Umax=1,
    Umin=0,
    Vmax=1,
    Vmin=0,
    Wrap=1)

# ----
# Wickerson Studio
# created by: Michael Wickerson
# Grasshopper for Rhino 3D Algorithmic Modeling
# www.wickersonstudios.com
# www.michaelwickerson.com
# https://www.youtube.com/channel/UC7J48Ppcsa6oncp6d29R0xw
# https://github.com/mwickerson
# https://www.facebook.com/michael.wickerson
# https://www.linkedin.com/in/michael-wickerson-696a80156/
number_slider = Slider(140, range=0..140)
number_slider_2 = Slider(0.415, range=0..1)
expression = Expression(x=number_slider, Expression="x-1")
construct_domain = ConstructDomain(DomainStart=Slider(0.02, range=0.01..0.02), DomainEnd=Slider(1, range=0.01..1))
range = Range(Domain=construct_domain, Steps=expression)
multiplication = Multiplication(A=range, B=range)
number_slider_3 = Slider(80, range=0..100)
jitter = Jitter(List=multiplication, Jitter=number_slider_2, Seed=number_slider_3)  # -> Values, Indices
jitter_2 = Jitter(List=range, Jitter=1, Seed=number_slider_3)  # -> Values, Indices
series = Series(Start=0, Step=Slider(0.27, range=0..1), Count=number_slider)
cylinder = Cylinder(Base=PlaneXY(0, 0, 0), Radius=expr("x*2", jitter.Values), Length=jitter_2.Values)
unit_z = UnitZ(Factor=series)
construct_domain_2 = ConstructDomain(DomainStart=0, DomainEnd=Slider(1.36, range=0..2))
move = Move(Geometry=cylinder, Motion=unit_z)  # -> Geometry, Transform
range_2 = Range(Domain=construct_domain_2, Steps=expression)
cap_holes = CapHoles(Brep=move.Geometry)
pi = Pi(Factor=range_2)
area = Area(Geometry=cap_holes)  # -> Area, Centroid
construct_domain_3 = ConstructDomain(DomainStart=0, DomainEnd=Slider(7, range=0..100))
jitter_3 = Jitter(List=pi, Jitter=number_slider_2, Seed=number_slider_3)  # -> Values, Indices
yz_plane = YZPlane(Origin=Point(0, 0, 0))
range_3 = Range(Domain=construct_domain_3, Steps=expression)
rotate_3d = Rotate3D(Geometry=cap_holes, Angle=jitter_3.Values, Center=area.Centroid, Axis=yz_plane)  # -> Geometry, Transform
jitter_4 = Jitter(List=range_3, Jitter=number_slider_2, Seed=number_slider_3)  # -> Values, Indices
unit_x = UnitX(Factor=jitter_4.Values)
move_2 = Move(Geometry=rotate_3d.Geometry, Motion=unit_x)  # -> Geometry, Transform
rotate_3d_2 = Rotate3D(Geometry=move_2.Geometry, Angle=pi, Center=area.Centroid, Axis=Vector(0, 0, 1))  # -> Geometry, Transform
polar_array = PolarArray(Geometry=rotate_3d_2.Geometry, Plane=PlaneXY(0, 0, 0), Count=Slider(4, range=0..10), Angle=6.283185307)  # -> Geometry, Transform
dispatch = Dispatch(List=polar_array.Geometry, DispatchPattern=[True, False])  # -> ListA, ListB
geometry = Geometry(dispatch.ListB)
geometry_2 = Geometry(dispatch.ListA)

number_slider_4 = Slider(60, range=0..100)
number_slider_5 = Slider(56, range=0..100)
number_slider_6 = Slider(1, range=0..1)
construct_domain_4 = ConstructDomain(DomainStart=Slider(0.02, range=0.01..0.02), DomainEnd=Slider(0.421, range=0.01..1))
expression_2 = Expression(x=number_slider_5, Expression="x-1")
range_4 = Range(Domain=construct_domain_4, Steps=expression_2)
jitter_5 = Jitter(List=range_4, Jitter=number_slider_6, Seed=number_slider_4)  # -> Values, Indices
cylinder_2 = Cylinder(Base=PlaneXY(0, 0, 0), Radius=expr("x*2", jitter_5.Values), Length=jitter_5.Values)
series_2 = Series(Start=0, Step=1, Count=number_slider_5)
jitter_6 = Jitter(List=series_2, Jitter=number_slider_6, Seed=number_slider_4)  # -> Values, Indices
unit_z_2 = UnitZ(Factor=jitter_6.Values)
move_3 = Move(Geometry=cylinder_2, Motion=unit_z_2)  # -> Geometry, Transform
construct_domain_5 = ConstructDomain(DomainStart=0, DomainEnd=Slider(1.85, range=0..2))
cap_holes_2 = CapHoles(Brep=move_3.Geometry)
range_5 = Range(Domain=construct_domain_5, Steps=expression_2)
volume = Volume(Geometry=cap_holes_2)  # -> Volume, Centroid
param_viewer = ParamViewer(move_3.Geometry)
param_viewer_2 = ParamViewer(volume.Centroid)
yz_plane_2 = YZPlane(Origin=Point(0, 0, 0))
construct_domain_6 = ConstructDomain(DomainStart=0, DomainEnd=Slider(10, range=0..10))
jitter_7 = Jitter(List=range_5, Jitter=number_slider_6, Seed=number_slider_4)  # -> Values, Indices
pi_2 = Pi(Factor=jitter_7.Values)
param_viewer_3 = ParamViewer(pi_2)
range_6 = Range(Domain=construct_domain_6, Steps=expression_2)
rotate_3d_3 = Rotate3D(Geometry=move_3.Geometry, Angle=pi_2, Center=volume.Centroid, Axis=yz_plane_2)  # -> Geometry, Transform
unit_x_2 = UnitX(Factor=range_6)
move_4 = Move(Geometry=rotate_3d_3.Geometry, Motion=unit_x_2)  # -> Geometry, Transform
rotate_3d_4 = Rotate3D(Geometry=move_4.Geometry, Angle=pi_2, Center=volume.Centroid, Axis=Vector(0, 0, 1))  # -> Geometry, Transform
polar_array_2 = PolarArray(Geometry=rotate_3d_4.Geometry, Plane=PlaneXY(0, 0, 0), Count=Slider(6, range=0..10), Angle=6.283185307)  # -> Geometry, Transform
dispatch_2 = Dispatch(List=polar_array_2.Geometry, DispatchPattern=[True, False])  # -> ListA, ListB
geometry_3 = Geometry(dispatch_2.ListB)
geometry_4 = Geometry(dispatch_2.ListA)
