# Grasshopper definition WSBasicUnderstanding002.gh (Grasshopper 1.0.7)
# Copyright: Wickerson Studios
# plug-ins: Bifocals

pi = Pi(Factor=Slider(2, range=0..10))
construct_domain = ConstructDomain(DomainStart=0, DomainEnd=pi)
range = Range(Domain=graft(construct_domain), Steps=Slider(100, range=0..100))
sine = Sine(Value=range)
merge = Merge(Data1=Slider(5.11, range=0..10), Data2=Slider(4.95, range=0..10), Data3=Slider(6.45, range=0..10))  # -> graft(Result)
multiplication = Multiplication(A=sine, B=merge)
construct_domain_2 = ConstructDomain(DomainStart=0, DomainEnd=Slider(4.35, range=0..10))
construct_point = ConstructPoint(XCoordinate=range, YCoordinate=0, ZCoordinate=multiplication)
range_2 = Range(Domain=construct_domain_2, Steps=Slider(2, range=0..10))
nurbs_curve = NurbsCurve(Vertices=construct_point, Degree=3, Periodic=False)  # -> Curve, Length, Domain
unit_y = UnitY(Factor=range_2)
move = Move(Geometry=flatten(nurbs_curve.Curve), Motion=unit_y)  # -> Geometry, Transform
loft = Loft(Curves=move.Geometry, Options={Adjust=False, Closed=False, LoftEnds=0, LoftSimp=0, LoftType=0, Rebuild=10, Refit=0.01})
