# Grasshopper definition WSBasicUnderstanding004.gh (Grasshopper 1.0.7)
# Copyright: Wickerson Studios
# plug-ins: MeshEdit Components, Bifocals

number_slider = Slider(1, range=0..1)
construct_domain = ConstructDomain(DomainU=number_slider, DomainV=number_slider)
surface = Surface(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)
area = Area(Geometry=surface)  # -> Area, Centroid
isotrim = Isotrim(Surface=reparameterize(surface), Domain=construct_domain)
number_slider_2 = Slider(43, range=0..100)
deconstruct_brep = DeconstructBrep(Brep=isotrim)  # -> Faces, Edges, Vertices
area_2 = Area(Geometry=deconstruct_brep.Faces)  # -> Area, Centroid
surface_closest_point = SurfaceClosestPoint(Point=area_2.Centroid, Surface=deconstruct_brep.Faces)  # -> Point, UVPoint, Distance
divide_surface = DivideSurface(Surface=surface, UCount=number_slider_2, VCount=number_slider_2)  # -> Points, Normals, Parameters
evaluate_surface = EvaluateSurface(Surface=deconstruct_brep.Faces, Point=surface_closest_point.UVPoint)  # -> Point, Normal, UDirection, VDirection, Frame
vector_display = VectorDisplay(Anchor=divide_surface.Points, Vector=divide_surface.Normals)
amplitude = Amplitude(Vector=divide_surface.Normals, Amplitude=Slider(1.059, range=0..10))
vector_display_2 = VectorDisplay(Anchor=evaluate_surface.Point, Vector=evaluate_surface.Normal)
addition = Addition(A=number_slider_2, B=Slider(1, range=0..10))
move = Move(Geometry=divide_surface.Points, Motion=amplitude)  # -> flatten(Geometry), Transform
surface_from_points = SurfaceFromPoints(Points=move.Geometry, UCount=addition, Interpolate=False)
mesh_frompoints = MeshFromPoints(Points=move.Geometry, UDirection=addition, VDirection=addition)  # disabled

number_slider_3 = Slider(42, range=0..100)
surface_2 = Surface(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)
divide_surface_2 = DivideSurface(Surface=surface_2, UCount=number_slider_3, VCount=number_slider_3)  # -> Points, Normals, Parameters
amplitude_2 = Amplitude(Vector=divide_surface_2.Normals, Amplitude=Slider(0.981, range=0.001..2))
vector_display_3 = VectorDisplay(Anchor=divide_surface_2.Points, Vector=divide_surface_2.Normals)
move_2 = Move(Geometry=divide_surface_2.Points, Motion=amplitude_2)  # -> flatten(Geometry), Transform
expression = Expression(x=number_slider_3, Expression="x+1")
surface_from_points_2 = SurfaceFromPoints(Points=move_2.Geometry, UCount=expression, Interpolate=False)
mesh_frompoints_2 = MeshFromPoints(Points=move_2.Geometry, UDirection=expression, VDirection=expression)
deconstruct_brep_2 = DeconstructBrep(Brep=surface_from_points_2)  # -> Faces, graft(Edges), Vertices
deconstruct_brep_3 = DeconstructBrep(Brep=surface_2)  # -> Faces, graft(Edges), Vertices
loft = Loft(
    Curves=[deconstruct_brep_2.Edges, deconstruct_brep_3.Edges],
    Options={Adjust=False, Closed=False, LoftEnds=0, LoftSimp=0, LoftType=0, Rebuild=10, Refit=0.01})  # -> flatten(Loft)

merge = Merge(Data1=surface_from_points_2, Data2=loft, Data3=surface_2)

brep_join = BrepJoin(Breps=merge)  # -> Breps, Closed
