# Grasshopper definition WSBasicUnderstanding005.gh (Grasshopper 1.0.7)
# Copyright: Wickerson Studios
# plug-ins: MeshEdit Components, Bifocals

number_slider = Slider(93, range=0..100)
plane_surface = PlaneSurface(Plane=PlaneXY(0, 0, 0), XSize=number_slider, YSize=number_slider)
surface = Surface(plane_surface)
dimensions = Dimensions(Surface=surface)  # -> UDimension, VDimension
number_slider_2 = Slider(14, range=0..50)
md_slider = MDSlider(
    SliderMode=0,
    slider_value=Point(0.7319843944, 0.457247106, 0.5),
    x_domain=Domain(0, 1),
    y_domain=Domain(0, 1),
    z_domain=Domain(0, 1))
division = Division(A=dimensions.UDimension, B=dimensions.VDimension)
area = Area(Geometry=surface)  # -> Area, Centroid
multiplication = Multiplication(A=division, B=number_slider_2)
integer = Integer(multiplication)
scale = Scale(Geometry=surface, Center=area.Centroid, Factor=Slider(1.55, range=0..5))  # -> Geometry, Transform
divide_surface = DivideSurface(Surface=surface, UCount=integer, VCount=number_slider_2)  # -> flatten(Points), Normals, Parameters
expression = Expression(x=integer, Expression="x+1")
evaluate_surface = EvaluateSurface(Surface=reparameterize(scale.Geometry), Point=md_slider)  # -> Point, Normal, UDirection, VDirection, Frame
distance = Distance(PointA=graft(evaluate_surface.Point), PointB=divide_surface.Points)
expression_2 = Expression(w=graft(Slider(0.106, range=0..2)), t=distance, Expression="sin(w*t)^2")

flip_matrix = FlipMatrix(Data=expression_2)
mass_multiplication = MassMultiplication(Input=flip_matrix)  # -> flatten(Result), PartialResults

multiplication_2 = Multiplication(A=mass_multiplication.Result, B=mass_multiplication.Result)

multiplication_3 = Multiplication(A=Slider(12.89, range=0..20), B=multiplication_2)
unit_z = UnitZ(Factor=multiplication_3)
move = Move(Geometry=divide_surface.Points, Motion=unit_z)  # -> Geometry, Transform
surface_from_points = SurfaceFromPoints(Points=move.Geometry, UCount=expression, Interpolate=False)

number_slider_3 = Slider(5, range=0..100)
surface_2 = Surface(surface_from_points)
divide_surface_2 = DivideSurface(Surface=surface_2, UCount=number_slider_3, VCount=number_slider_3)  # -> Points, Normals, Parameters
amplitude = Amplitude(Vector=divide_surface_2.Normals, Amplitude=Slider(7.534, range=0.001..12))
vector_display = VectorDisplay(Anchor=divide_surface_2.Points, Vector=divide_surface_2.Normals)
move_2 = Move(Geometry=divide_surface_2.Points, Motion=amplitude)  # -> flatten(Geometry), Transform
expression_3 = Expression(x=number_slider_3, Expression="x+1")
surface_from_points_2 = SurfaceFromPoints(Points=move_2.Geometry, UCount=expression_3, Interpolate=False)
mesh_frompoints = MeshFromPoints(Points=move_2.Geometry, UDirection=expression_3, VDirection=expression_3)
deconstruct_brep = DeconstructBrep(Brep=surface_from_points_2)  # -> Faces, graft(Edges), Vertices
deconstruct_brep_2 = DeconstructBrep(Brep=surface)  # -> Faces, graft(Edges), Vertices
geometry = Geometry(deconstruct_brep_2.Edges)
merge = Merge(Data1=deconstruct_brep.Edges, Data2=geometry)
loft = Loft(Curves=merge, Options={Adjust=False, Closed=False, LoftEnds=0, LoftSimp=0, LoftType=0, Rebuild=10, Refit=0.01})  # -> flatten(Loft)
geometry_2 = Geometry(surface)
merge_2 = Merge(Data1=surface_from_points_2, Data2=loft, Data3=geometry_2)
brep_join = BrepJoin(Breps=merge_2)  # -> Breps, Closed
