# Grasshopper definition WSBasicUnderstanding007b.gh (Grasshopper 1.0.7)
# Copyright: Wickerson Studios
# plug-ins: Bifocals, MeshEdit Components

spin_force = SpinForce(Plane=PlaneXY(0, 0, 0), Strength=1, Radius=5, Decay=2)  # disabled

field_line = FieldLine(Steps=1000, Accuracy=0.1, Method=3)  # disabled

point_charge = PointCharge(Charge=1, Decay=2)  # disabled

merge_fields = MergeFields()  # disabled

perpendicular_display = PerpendicularDisplay(Samples=1000, PositiveColour=RGB(255, 255, 255), NegativeColour=RGB(0, 0, 0))  # disabled
direction_display = DirectionDisplay(Samples=1000)  # disabled
evaluate_field = EvaluateField()  # -> Tensor, Strength; disabled
scalar_display = ScalarDisplay(Samples=1000)  # disabled
vector_force = VectorForce()  # disabled
break_field = BreakField()  # disabled
line_charge = LineCharge(Charge=1)  # disabled
tensor_display = TensorDisplay(Samples=1000)  # disabled

number_slider = Slider(10, range=0..10)  # disabled
construct_point = ConstructPoint(XCoordinate=0, YCoordinate=0, ZCoordinate=0)  # disabled
construct_point_2 = ConstructPoint(XCoordinate=number_slider, YCoordinate=number_slider, ZCoordinate=number_slider)  # disabled
vector_2pt = Vector2Pt(PointA=construct_point, PointB=construct_point_2, Unitize=False)  # -> Vector, Length; disabled
vector_display = VectorDisplay(Anchor=construct_point, Vector=vector_2pt.Vector)  # disabled

number_slider_2 = Slider(73, range=0..100)  # disabled
number_slider_3 = Slider(2, range=0..10)  # disabled
number_slider_4 = Slider(63, range=0..100)  # disabled
square = Square(Plane=PlaneXY(0, 0, 0), Size=number_slider_3, ExtentX=number_slider_2, ExtentY=number_slider_2)  # -> Cells, Points; disabled
construct_point_3 = ConstructPoint(XCoordinate=number_slider_4, YCoordinate=number_slider_4, ZCoordinate=number_slider_4)  # disabled
number_slider_5 = Slider(27, range=0..100)  # disabled
area = Area(Geometry=square.Cells)  # -> Area, Centroid; disabled
vector_2pt_2 = Vector2Pt(PointA=construct_point_3, PointB=area.Centroid, Unitize=False)  # -> Vector, Length; disabled
negative = Negative(Value=number_slider_5)  # disabled
vector_display_2 = VectorDisplay(Anchor=construct_point_3, Vector=vector_2pt_2.Vector)  # disabled
line_sdl = LineSDL(Start=area.Centroid, Direction=vector_2pt_2.Vector, Length=negative)  # disabled
end_points = EndPoints(Curve=line_sdl)  # -> flatten(Start), flatten(End); disabled
surface_from_points = SurfaceFromPoints(Points=end_points.End, UCount=number_slider_2, Interpolate=False)  # disabled

number_slider_6 = Slider(68, range=0..100)  # disabled
circle = Circle(Plane=PlaneXY(0, 0, 0), Radius=number_slider_6)  # disabled
boundary_surfaces = BoundarySurfaces(Edges=circle)  # disabled
number_slider_7 = Slider(1, range=0..1)  # disabled
divide_surface = DivideSurface(Surface=boundary_surfaces, UCount=10, VCount=10)  # -> Points, Normals, Parameters; disabled
number_slider_8 = Slider(4503, range=0..10000)  # disabled

number_slider_9 = Slider(37, range=0..100)  # disabled
number_slider_10 = Slider(21, range=0..100)  # disabled
negative_2 = Negative(Value=number_slider_9)  # disabled
number_slider_11 = Slider(2, range=0..10)  # disabled
number_slider_12 = Slider(1, range=0..1)  # disabled
construct_domain = ConstructDomain(DomainStart=number_slider_9, DomainEnd=negative_2)  # disabled
number_slider_13 = Slider(1.5, range=0..10)  # disabled
circle_2 = Circle(Plane=PlaneXY(0, 0, 0), Radius=number_slider_10)  # disabled
number_slider_14 = Slider(5.7, range=0..10)  # disabled
number_slider_15 = Slider(2, range=0..10)  # disabled
number_slider_16 = Slider(0.9, range=0..1)  # disabled
divide_curve = DivideCurve(Curve=circle_2, Count=number_slider_11, Kinks=False)  # -> Points, Tangents, Parameters; disabled
rectangle = Rectangle(Plane=PlaneXY(0, 0, 0), XSize=construct_domain, YSize=construct_domain, Radius=0)  # -> Rectangle, Length; disabled
number_slider_17 = Slider(5, range=0..10)  # disabled
number_slider_18 = Slider(20, range=0..100)  # disabled
point_charge_2 = PointCharge(Point=divide_curve.Points, Charge=number_slider_12, Decay=number_slider_13, Bounds=rectangle.Rectangle)  # disabled
spin_force_2 = SpinForce(
    Plane=divide_curve.Points,
    Strength=number_slider_16,
    Radius=number_slider_14,
    Decay=number_slider_15,
    Bounds=rectangle.Rectangle)  # disabled
circle_3 = Circle(Plane=divide_curve.Points, Radius=number_slider_17)  # disabled
merge_fields_2 = MergeFields(Fields=[point_charge_2, spin_force_2])  # disabled
divide_curve_2 = DivideCurve(Curve=circle_3, Count=number_slider_18, Kinks=False)  # -> Points, Tangents, Parameters; disabled
field_line_2 = FieldLine(Field=merge_fields_2, Point=divide_curve_2.Points, Steps=1000, Accuracy=0.1, Method=3)  # disabled

number_slider_19 = Slider(33, range=0..100)  # disabled
number_slider_20 = Slider(2, range=0..10)  # disabled
negative_3 = Negative(Value=number_slider_19)  # disabled
number_slider_21 = Slider(2, range=0..10)  # disabled
division = Division(A=number_slider_19, B=number_slider_20)  # disabled
number_slider_22 = Slider(1, range=0..1)  # disabled
construct_domain_2 = ConstructDomain(DomainStart=number_slider_19, DomainEnd=negative_3)  # disabled
number_slider_23 = Slider(1.5, range=0..10)  # disabled
circle_4 = Circle(Plane=PlaneXY(0, 0, 0), Radius=division)  # disabled
number_slider_24 = Slider(5.7, range=0..10)  # disabled
number_slider_25 = Slider(2, range=0..10)  # disabled
number_slider_26 = Slider(0.9, range=0..1)  # disabled
divide_curve_3 = DivideCurve(Curve=circle_4, Count=number_slider_21, Kinks=False)  # -> Points, Tangents, Parameters; disabled
rectangle_2 = Rectangle(Plane=PlaneXY(0, 0, 0), XSize=construct_domain_2, YSize=construct_domain_2, Radius=0)  # -> Rectangle, Length; disabled
number_slider_27 = Slider(5, range=0..10)  # disabled
number_slider_28 = Slider(20, range=0..100)  # disabled
point_charge_3 = PointCharge(Point=divide_curve_3.Points, Charge=number_slider_22, Decay=number_slider_23, Bounds=rectangle_2.Rectangle)  # disabled
spin_force_3 = SpinForce(
    Plane=divide_curve_3.Points,
    Strength=number_slider_26,
    Radius=number_slider_24,
    Decay=number_slider_25,
    Bounds=rectangle_2.Rectangle)  # disabled
circle_5 = Circle(Plane=divide_curve_3.Points, Radius=number_slider_27)  # disabled
merge_fields_3 = MergeFields(Fields=[point_charge_3, spin_force_3])  # disabled
divide_curve_4 = DivideCurve(Curve=circle_5, Count=number_slider_28, Kinks=False)  # -> Points, Tangents, Parameters; disabled
field_line_3 = FieldLine(Field=merge_fields_3, Point=divide_curve_4.Points, Steps=1000, Accuracy=0.1, Method=3)  # -> flatten(Curve); disabled
number_slider_29 = Slider(34, range=0..100)  # disabled
list_length = ListLength(List=field_line_3)  # disabled
construct_domain_3 = ConstructDomain(DomainStart=0, DomainEnd=number_slider_29)  # disabled
range = Range(Domain=construct_domain_3, Steps=list_length)  # disabled
unit_z = UnitZ(Factor=range)  # disabled
number_slider_30 = Slider(1, range=0..1)  # disabled
move = Move(Geometry=field_line_3, Motion=unit_z)  # -> Geometry, Transform; disabled
divide_curve_5 = DivideCurve(Curve=move.Geometry, Count=10, Kinks=False)  # -> flatten(Points), Tangents, Parameters; disabled
addition = Addition(A=list_length, B=number_slider_30)  # disabled
surface_from_points_2 = SurfaceFromPoints(Points=divide_curve_5.Points, UCount=addition, Interpolate=False)  # disabled

number_slider_31 = Slider(4, range=-10..10)  # disabled
number_slider_32 = Slider(-9, range=-10..10)  # disabled
number_slider_33 = Slider(5, range=-10..10)  # disabled
number_slider_34 = Slider(6, range=-10..10)  # disabled

point_charge_4 = PointCharge(Point=Point(-67, 0, 0), Charge=number_slider_31, Decay=number_slider_7)  # disabled
point_charge_5 = PointCharge(Point=Point(67, 0, 0), Charge=number_slider_34, Decay=number_slider_7)  # disabled

point_charge_6 = PointCharge(Point=Point(-67, 0, 0), Charge=number_slider_32, Decay=number_slider_7)  # disabled
point_charge_7 = PointCharge(Point=Point(67, 0, 0), Charge=number_slider_33, Decay=number_slider_7)  # disabled

merge_fields_4 = MergeFields(Fields=[point_charge_6, point_charge_7, point_charge_4, point_charge_5])  # disabled

field_line_4 = FieldLine(Field=merge_fields_4, Point=divide_surface.Points, Steps=number_slider_8, Accuracy=0.1, Method=3)  # disabled

number_slider_35 = Slider(93, range=0..100)  # disabled
plane_surface = PlaneSurface(Plane=PlaneXY(0, 0, 0), XSize=number_slider_35, YSize=number_slider_35)  # disabled
number_slider_36 = Slider(1.55, range=0..5)  # disabled
surface = Surface(surface_from_points)  # disabled
dimensions = Dimensions(Surface=surface)  # -> UDimension, VDimension; disabled
number_slider_37 = Slider(14, range=0..50)  # disabled
md_slider = MDSlider(
    SliderMode=0,
    slider_value=Point(0.4141400965, 0.3752348365, 0.5),
    x_domain=Domain(0, 1),
    y_domain=Domain(0, 1),
    z_domain=Domain(0, 1))  # disabled
division_2 = Division(A=dimensions.UDimension, B=dimensions.VDimension)  # disabled
area_2 = Area(Geometry=surface)  # -> Area, Centroid; disabled
multiplication = Multiplication(A=division_2, B=number_slider_37)  # disabled
integer = Integer(multiplication)  # disabled
scale = Scale(Geometry=surface, Center=area_2.Centroid, Factor=number_slider_36)  # -> Geometry, Transform; disabled
divide_surface_2 = DivideSurface(Surface=surface, UCount=integer, VCount=number_slider_37)  # -> flatten(Points), Normals, Parameters; disabled
number_slider_38 = Slider(0.106, range=0..2)  # disabled
expression = Expression(x=integer, Expression="x+1")  # disabled
evaluate_surface = EvaluateSurface(Surface=reparameterize(scale.Geometry), Point=md_slider)  # -> Point, Normal, UDirection, VDirection, Frame; disabled
distance = Distance(PointA=graft(evaluate_surface.Point), PointB=divide_surface_2.Points)  # disabled
expression_2 = Expression(w=graft(number_slider_38), t=distance, Expression="sin(w*t)^2")  # disabled
number_slider_39 = Slider(14.83, range=0..20)  # disabled
multiplication_2 = Multiplication(A=number_slider_39, B=expression_2)  # disabled
unit_z_2 = UnitZ(Factor=multiplication_2)  # disabled
move_2 = Move(Geometry=divide_surface_2.Points, Motion=unit_z_2)  # -> Geometry, Transform; disabled
surface_from_points_3 = SurfaceFromPoints(Points=move_2.Geometry, UCount=expression, Interpolate=False)  # disabled

number_slider_40 = Slider(93, range=0..100)  # disabled
plane_surface_2 = PlaneSurface(Plane=PlaneXY(0, 0, 0), XSize=number_slider_40, YSize=number_slider_40)  # disabled
number_slider_41 = Slider(1.55, range=0..5)  # disabled
surface_2 = Surface(surface_from_points_2)  # disabled
dimensions_2 = Dimensions(Surface=surface_2)  # -> UDimension, VDimension; disabled
number_slider_42 = Slider(14, range=0..50)  # disabled
md_slider_2 = MDSlider(
    SliderMode=0,
    slider_value=Point(0.4141400965, 0.3752348365, 0.5),
    x_domain=Domain(0, 1),
    y_domain=Domain(0, 1),
    z_domain=Domain(0, 1))  # disabled
division_3 = Division(A=dimensions_2.UDimension, B=dimensions_2.VDimension)  # disabled
area_3 = Area(Geometry=surface_2)  # -> Area, Centroid; disabled
multiplication_3 = Multiplication(A=division_3, B=number_slider_42)  # disabled
integer_2 = Integer(multiplication_3)  # disabled
scale_2 = Scale(Geometry=surface_2, Center=area_3.Centroid, Factor=number_slider_41)  # -> Geometry, Transform; disabled
divide_surface_3 = DivideSurface(Surface=surface_2, UCount=integer_2, VCount=number_slider_42)  # -> flatten(Points), Normals, Parameters; disabled
number_slider_43 = Slider(0.106, range=0..2)  # disabled
expression_3 = Expression(x=integer_2, Expression="x+1")  # disabled
evaluate_surface_2 = EvaluateSurface(Surface=reparameterize(scale_2.Geometry), Point=md_slider_2)  # -> Point, Normal, UDirection, VDirection, Frame; disabled
distance_2 = Distance(PointA=graft(evaluate_surface_2.Point), PointB=divide_surface_3.Points)  # disabled
expression_4 = Expression(w=graft(number_slider_43), t=distance_2, Expression="sin(w*t)^2")  # disabled
number_slider_44 = Slider(14.83, range=0..20)  # disabled
multiplication_4 = Multiplication(A=number_slider_44, B=expression_4)  # disabled
unit_z_3 = UnitZ(Factor=multiplication_4)  # disabled
move_3 = Move(Geometry=divide_surface_3.Points, Motion=unit_z_3)  # -> Geometry, Transform; disabled
surface_from_points_4 = SurfaceFromPoints(Points=move_3.Geometry, UCount=expression_3, Interpolate=False)  # disabled
number_slider_45 = Slider(2, range=0..10)  # disabled
unit_z_4 = UnitZ(Factor=number_slider_45)  # disabled
extrude = Extrude(Base=surface_from_points_4, Direction=unit_z_4)  # disabled

flip_matrix = FlipMatrix(Data=expression_2)  # disabled
mass_multiplication = MassMultiplication(Input=flip_matrix)  # -> flatten(Result), PartialResults; disabled
mass_addition = MassAddition(Input=flip_matrix)  # -> flatten(Result), PartialResults; disabled

number_slider_46 = Slider(5, range=0..100)  # disabled
surface_3 = Surface(surface_from_points_3)  # disabled
number_slider_47 = Slider(7.534, range=0.001..12)  # disabled
divide_surface_4 = DivideSurface(Surface=surface_3, UCount=number_slider_46, VCount=number_slider_46)  # -> Points, Normals, Parameters; disabled
amplitude = Amplitude(Vector=divide_surface_4.Normals, Amplitude=number_slider_47)  # disabled
vector_display_3 = VectorDisplay(Anchor=divide_surface_4.Points, Vector=divide_surface_4.Normals)  # disabled
move_4 = Move(Geometry=divide_surface_4.Points, Motion=amplitude)  # -> flatten(Geometry), Transform; disabled
expression_5 = Expression(x=number_slider_46, Expression="x+1")  # disabled
surface_from_points_5 = SurfaceFromPoints(Points=move_4.Geometry, UCount=expression_5, Interpolate=False)  # disabled
mesh_frompoints = MeshFromPoints(Points=move_4.Geometry, UDirection=expression_5, VDirection=expression_5)  # disabled
deconstruct_brep = DeconstructBrep(Brep=surface_from_points_5)  # -> Faces, graft(Edges), Vertices; disabled
deconstruct_brep_2 = DeconstructBrep(Brep=surface)  # -> Faces, graft(Edges), Vertices; disabled
geometry = Geometry(deconstruct_brep_2.Edges)  # disabled
merge = Merge(Data1=deconstruct_brep.Edges, Data2=geometry)  # disabled
loft = Loft(Curves=merge, Options={Adjust=False, Closed=False, LoftEnds=0, LoftSimp=0, LoftType=0, Rebuild=10, Refit=0.01})  # -> flatten(Loft); disabled
geometry_2 = Geometry(surface)  # disabled
merge_2 = Merge(Data1=surface_from_points_5, Data2=loft, Data3=geometry_2)  # disabled
brep_join = BrepJoin(Breps=merge_2)  # -> Breps, Closed; disabled

flip_matrix_2 = FlipMatrix(Data=expression_4)  # disabled
mass_multiplication_2 = MassMultiplication(Input=flip_matrix_2)  # -> flatten(Result), PartialResults; disabled
mass_addition_2 = MassAddition(Input=flip_matrix_2)  # -> flatten(Result), PartialResults; disabled

number_slider_48 = Slider(61, range=0..100)  # disabled
number_slider_49 = Slider(43.45, range=0..100)  # disabled
number_slider_50 = Slider(20, range=0..100)  # disabled
number_slider_51 = Slider(42.15, range=0..100)  # disabled
circle_6 = Circle(Plane=PlaneXY(0, 0, 0), Radius=number_slider_48)  # disabled
boundary_surfaces_2 = BoundarySurfaces(Edges=circle_6)  # disabled
point = Point(Point(14, 48, 0))  # disabled
point_2 = Point(Point(26, -24, 0))  # disabled
point_3 = Point(Point(-39, -13, 0))  # disabled
populate_geometry = PopulateGeometry(Geometry=boundary_surfaces_2, Count=100, Seed=1)  # -> flatten(Population); disabled
populate_3d = Populate3D(Region=boundary_surfaces_2, Count=100, Seed=1)  # disabled
number_slider_52 = Slider(100, range=0..100)  # disabled
closest_point = ClosestPoint(Point=populate_geometry, Cloud=[point_3, point, point_2])  # -> ClosestPoint, CPIndex, Distance; disabled
multiplication_5 = Multiplication(A=closest_point.Distance, B=number_slider_52)  # disabled

spin_force_4 = SpinForce(Plane=point_3, Strength=1, Radius=number_slider_50, Decay=2)  # disabled
spin_force_5 = SpinForce(Plane=point, Strength=1, Radius=number_slider_51, Decay=2)  # disabled
spin_force_6 = SpinForce(Plane=point_2, Strength=1, Radius=number_slider_49, Decay=2)  # disabled

merge_fields_5 = MergeFields(Fields=[spin_force_4, spin_force_5, spin_force_6])  # disabled
field_line_5 = FieldLine(Field=merge_fields_5, Point=populate_geometry, Steps=multiplication_5, Accuracy=0.1, Method=3)  # disabled

circle_7 = Circle(Plane=PlaneXY(0, 0, 0), Radius=Slider(20, range=0..100))
boundary_surfaces_3 = BoundarySurfaces(Edges=circle_7)
point_4 = Point(Point(14, 48, 0))
point_5 = Point(Point(26, -24, 0))
point_6 = Point(Point(-39, -13, 0))
populate_geometry_2 = PopulateGeometry(Geometry=boundary_surfaces_3, Count=100, Seed=1)  # -> flatten(Population)
populate_3d_2 = Populate3D(Region=boundary_surfaces_3, Count=100, Seed=1)
closest_point_2 = ClosestPoint(Point=populate_geometry_2, Cloud=[point_6, point_4, point_5])  # -> ClosestPoint, CPIndex, Distance
multiplication_6 = Multiplication(A=closest_point_2.Distance, B=Slider(10, range=0..10))

spin_force_7 = SpinForce(Plane=point_6, Strength=1, Radius=Slider(100, range=0..100), Decay=2)
spin_force_8 = SpinForce(Plane=point_4, Strength=1, Radius=Slider(42.15, range=0..100), Decay=2)
spin_force_9 = SpinForce(Plane=point_5, Strength=1, Radius=Slider(43.45, range=0..100), Decay=2)

merge_fields_6 = MergeFields(Fields=[spin_force_7, spin_force_8, spin_force_9])
field_line_6 = FieldLine(Field=merge_fields_6, Point=populate_geometry_2, Steps=multiplication_6, Accuracy=0.1, Method=3)

list_length_2 = ListLength(List=field_line_6)
expression_6 = Expression(x=list_length_2, Expression="x-1")
construct_domain_4 = ConstructDomain(DomainStart=0, DomainEnd=Slider(12.33, range=0..100))
range_2 = Range(Domain=construct_domain_4, Steps=expression_6)
jitter = Jitter(List=range_2, Jitter=1, Seed=2)  # -> Values, Indices
unit_z_5 = UnitZ(Factor=jitter.Values)
number_slider_53 = Slider(0.328, range=0..1)
move_5 = Move(Geometry=field_line_6, Motion=unit_z_5)  # -> flatten(Geometry), Transform
list_length_3 = ListLength(List=move_5.Geometry)

number_slider_54 = Slider(1.439, range=0..2)
md_slider_3 = MDSlider(
    SliderMode=0,
    slider_value=Point(0.712735432, 0.3769590796, 0.5),
    x_domain=Domain(0, 1),
    y_domain=Domain(0, 1),
    z_domain=Domain(0, 1))
surface_4 = Surface(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)

number_slider_55 = Slider(21, range=0..100)
surface_5 = Surface(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)
dimensions_3 = Dimensions(Surface=surface_5)  # -> UDimension, VDimension
division_4 = Division(A=dimensions_3.UDimension, B=dimensions_3.VDimension)
multiplication_7 = Multiplication(A=division_4, B=number_slider_55)

area_4 = Area(Geometry=surface_5)  # -> Area, Centroid
integer_3 = Integer(multiplication_7)
scale_3 = Scale(Geometry=surface_5, Center=area_4.Centroid, Factor=Slider(2.66, range=0..5))  # -> Geometry, Transform
expression_7 = Expression(x=integer_3, Expression="x+1")
evaluate_surface_3 = EvaluateSurface(Surface=reparameterize(scale_3.Geometry), Point=md_slider_3)  # -> Point, Normal, UDirection, VDirection, Frame

divide_surface_5 = DivideSurface(Surface=surface_5, UCount=integer_3, VCount=number_slider_55)  # -> flatten(Points), Normals, Parameters

distance_3 = Distance(PointA=evaluate_surface_3.Point, PointB=divide_surface_5.Points)
expression_8 = Expression(w=graft(number_slider_54), t=distance_3, k=Slider(-7, range=-10..10), Expression="sin(w*t + k*sin(w*t))")
expression_9 = Expression(w=graft(number_slider_54), t=distance_3, Expression="sin(w*t)^2")
multiplication_8 = Multiplication(A=Slider(5.84, range=0..10), B=expression_8)
unit_z_6 = UnitZ(Factor=multiplication_8)
move_6 = Move(Geometry=divide_surface_5.Points, Motion=unit_z_6)  # -> Geometry, Transform
surface_from_points_6 = SurfaceFromPoints(Points=move_6.Geometry, UCount=expression_7, Interpolate=False)

construct_domain_5 = ConstructDomain(DomainStart=0, DomainEnd=Slider(2, range=0..100))
expression_10 = Expression(x=number_slider_53, w=Slider(5, range=0..10), Expression="x*w*sin(2)")
range_3 = Range(Domain=construct_domain_5, Steps=list_length_3)
multiplication_9 = Multiplication(A=expression_10, B=range_3)

pi = Pi(Factor=multiplication_9)
rotate_3d = Rotate3D(Geometry=move_5.Geometry, Angle=multiplication_9, Center=Point(0, 0, 0), Axis=Vector(0, 0, 1))  # -> Geometry, Transform
rotate_axis = RotateAxis(Geometry=rotate_3d.Geometry, Angle=pi, Axis=Line((0, 0, 0), (10, 0, 0)))  # -> Geometry, Transform
pipe = Pipe(Curve=rotate_axis.Geometry, Radius=number_slider_53, Caps=Toggle(True))

end_points_2 = EndPoints(Curve=rotate_axis.Geometry)  # -> Start, End
mesh_sphere = MeshSphere(Base=end_points_2.Start, Radius=multiplication_9, UCount=10, VCount=20)
