# Grasshopper definition WickersonStudiosTemplateFile.gh (Grasshopper 1.0.7)
# Copyright: Wickerson Studios
# plug-ins: Bifocals

# Wickerson Studio
# 
# created by: Michael Wickerson
# 
# Grasshopper for Rhino 3D Algorithmic Modeling
# 
# www.wickersonstudios.com
# www.michaelwickerson.com
# https://www.youtube.com/channel/UC7J48Ppcsa6oncp6d29R0xw
# https://github.com/mwickerson
# https://www.facebook.com/michael.wickerson
# https://www.linkedin.com/in/michael-wickerson-696a80156/
# Wickerson Studio
# created by: Michael Wickerson
# Grasshopper for Rhino 3D Algorithmic Modeling
# www.wickersonstudios.com
# www.michaelwickerson.com
# https://www.youtube.com/channel/UC7J48Ppcsa6oncp6d29R0xw
# https://github.com/mwickerson
# https://www.facebook.com/michael.wickerson
# https://www.linkedin.com/in/michael-wickerson-696a80156/
image_sampler = ImageSampler(
    FilePath="C:\Users\Sculpture\Documents\2020Grasshopper\ScreenShots2019\Screenshots2020\SurfaceEditAlgorithm.PNG",
    Filter="Value",
    Interpolate=False,
    Umax=1,
    Umin=0,
    Vmax=1,
    Vmin=0,
    Wrap=1)

number_slider = Slider(139, range=0..140)
number_slider_2 = Slider(0.605, range=0..1)
number_slider_3 = Slider(12, range=0..100)
expression = Expression(x=number_slider, Expression="x-1")
construct_domain = ConstructDomain(DomainStart=Slider(0.02, range=0.01..0.02), DomainEnd=Slider(1, range=0.01..1))
range = Range(Domain=construct_domain, Steps=expression)
multiplication = Multiplication(A=range, B=range)
series = Series(Start=0, Step=Slider(0.27, range=0..1), Count=number_slider)
jitter = Jitter(List=multiplication, Jitter=number_slider_2, Seed=number_slider_3)  # -> Values, Indices
jitter_2 = Jitter(List=range, Jitter=1, Seed=number_slider_3)  # -> Values, Indices
unit_z = UnitZ(Factor=series)
cylinder = Cylinder(Base=PlaneXY(0, 0, 0), Radius=expr("x*2", jitter.Values), Length=jitter_2.Values)
construct_domain_2 = ConstructDomain(DomainStart=0, DomainEnd=Slider(1.36, range=0..2))
move = Move(Geometry=cylinder, Motion=unit_z)  # -> Geometry, Transform
range_2 = Range(Domain=construct_domain_2, Steps=expression)
cap_holes = CapHoles(Brep=move.Geometry)
pi = Pi(Factor=range_2)
jitter_3 = Jitter(List=pi, Jitter=number_slider_2, Seed=number_slider_3)  # -> Values, Indices
area = Area(Geometry=cap_holes)  # -> Area, Centroid
yz_plane = YZPlane(Origin=Point(0, 0, 0))
rotate_3d = Rotate3D(Geometry=cap_holes, Angle=jitter_3.Values, Center=area.Centroid, Axis=yz_plane)  # -> Geometry, Transform
construct_domain_3 = ConstructDomain(DomainStart=0, DomainEnd=Slider(7, range=0..100))
range_3 = Range(Domain=construct_domain_3, Steps=expression)
jitter_4 = Jitter(List=range_3, Jitter=number_slider_2, Seed=number_slider_3)  # -> Values, Indices
unit_x = UnitX(Factor=jitter_4.Values)
move_2 = Move(Geometry=rotate_3d.Geometry, Motion=unit_x)  # -> Geometry, Transform
rotate_3d_2 = Rotate3D(Geometry=move_2.Geometry, Angle=pi, Center=area.Centroid, Axis=Vector(0, 0, 1))  # -> Geometry, Transform
polar_array = PolarArray(Geometry=rotate_3d_2.Geometry, Plane=PlaneXY(0, 0, 0), Count=Slider(4, range=0..10), Angle=6.283185307)  # -> Geometry, Transform
dispatch = Dispatch(List=polar_array.Geometry, DispatchPattern=[True, False])  # -> ListA, ListB
geometry = Geometry(dispatch.ListA)
geometry_2 = Geometry(dispatch.ListB)
